# Grasshopper definition build.gh (Grasshopper 1.0.7)
# plug-ins: Firefly.X

file = ReadFile(File="C:\Users\Ozguc Capunaman\Documents\GitHub\InteractiveDigitalFabrication\py\ghPython.py", PerLineParse=False)
geo = Geometry(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)
pt = Point(Point(2000, 0, 500))

timer = Timer(TimerInterval=1, Target=[udp_listener, udp_sender])
udp_listener = UDPListener(Port="5005")

python = GhPythonScript(Code=file, RUN=Toggle(True), RESET=Button(), Init_geo=geo, Udp_in=udp_listener, WObj=pt)  # -> Out, Udp_out, Geo, Crv

len = TextLength(Text=udp_listener)
equals = Equality(FirstNumber=len, SecondNumber=0)  # -> Equality, Inequality
dispatch = Dispatch(List=udp_listener, DispatchPattern=equals.Inequality)  # -> ListA, ListB
len_2 = TextLength(Text=python.Udp_out)  # disabled
rec = DataRecorder(dispatch.ListA, DataLimit=-10, RecordData=True)
equals_2 = Equality(FirstNumber=len_2, SecondNumber=0)  # -> Equality, Inequality; disabled
panel = Panel(rec)
dispatch_2 = Dispatch(List=python.Udp_out, DispatchPattern=equals_2.Inequality)  # -> ListA, ListB; disabled
rec_2 = DataRecorder(python.Out, DataLimit=-10, RecordData=True)
rec_3 = DataRecorder(dispatch_2.ListA, DataLimit=-10, RecordData=True)  # disabled
panel_2 = Panel(rec_3)  # disabled
panel_3 = Panel(rec_2)

udp_sender = UDPSender(Data=python.Udp_out, IPAddressOfUDPServer="127.0.0.1", UDPPort="5004")
